# Grasshopper definition algoritmos_otimizacao.gh (Grasshopper 0.9.76)
# plug-ins: Python Interpreter

python = PythonScript()  # -> out, a
# ---------- python: Python ----------
import time
import random
import math

pessoas = [('Amanda', 'CWB'), 
		('Pedro', 'GIG'), 
		('Marcos','POA'), 
		('Priscila','FLN'), 
		('Jessica', 'CNF'), 
		('Paulo', 'GYN')]

destino = 'GRU'

voos = {}
for linha in open('voos.txt'):
	#print(linha)
	_origem, _destino, _saida, _chegada, _preco = linha.split(',')
	voos.setdefault((_origem, _destino), [])
	voos[(_origem, _destino)].append((_saida, _chegada, int(_preco)))

#print(voos['GRU', 'CWB'])

def imprimir_agenda(agenda):
	id_voo = -1
	for i in range(len(agenda) // 2):
		nome = pessoas[i][0]
		origem = pessoas[i][1]
		id_voo += 1
		ida = voos[(origem, destino)][agenda[id_voo]]
		id_voo += 1
		volta = voos[(destino, origem)][agenda[id_voo]]
		print('%10s%10s %5s-%5s R$%3s %5s-%5s R$%3s' %(nome, origem, ida[0], ida[1], ida[2], volta[0], volta[1], volta[2]))

agenda = [1,4, 3,2, 7,3, 6,3, 2,4, 5,3]
imprimir_agenda(agenda)

def get_minutos(hora):
	x = time.strptime(hora, '%H:%M')
	minutos = x[3] * 60 + x[4]
	return minutos

get_minutos('6:13')
get_minutos('23:53')
get_minutos('00:00')

def funcao_custo(solucao):
	preco_total = 0
	ultima_chegada = 0
	primeira_partida = 1439

	id_voo = -1
	for i in range(len(solucao) // 2):
		origem = pessoas[i][1]
		id_voo += 1
		ida = voos[(origem, destino)][solucao[id_voo]]
		id_voo += 1
		volta = voos[(destino, origem)][solucao[id_voo]]

		preco_total += ida[2]
		preco_total += volta[2]

		if ultima_chegada < get_minutos(ida[1]):
			ultima_chegada = get_minutos(ida[1])
		
		if primeira_partida > get_minutos(volta[0]):
			primeira_partida = get_minutos(volta[0])

	total_espera = 0
	id_voo = -1
	for i in range(len(solucao) // 2):
		origem = pessoas[i][1]
		id_voo += 1
		ida = voos[(origem, destino)][solucao[id_voo]]
		id_voo += 1
		volta = voos[(destino, origem)][solucao[id_voo]]

		total_espera += ultima_chegada - get_minutos(ida[1])
		total_espera += get_minutos(volta[0]) - primeira_partida

	if ultima_chegada > primeira_partida:
		preco_total += 50 #penalidade

	return preco_total + total_espera

funcao_custo(agenda)

def pesquisa_randomica(dominio, funcao_custo):
	melhor_custo = 99999999
	for i in range(0, 1000):
		solucao = [random.randint(dominio[i][0], dominio[i][1]) for i in range(len(dominio))]
		custo = funcao_custo(solucao)
		if custo < melhor_custo:
			melhor_custo = custo
			melhor_solucao = solucao
	return melhor_solucao


dominio = [(0,9)] * (len(pessoas) * 2)
solucao_randomica = pesquisa_randomica(dominio, funcao_custo)
custo_randomica = funcao_custo(solucao_randomica)
imprimir_agenda(solucao_randomica)

def subida_encosta(dominio, funcao_custo):
	solucao = [random.randint(dominio[i][0], dominio[i][1]) for i in range(len(dominio))]
	while True:
		vizinhos = []

		for i in range(len(dominio)):
			if solucao[i] > dominio[i][0]:
				if solucao_randomica != dominio[i][1]:
					vizinhos.append(solucao[0:i] + [solucao[i] + 1] + solucao[i + 1])
			if solucao[i] < dominio[i][1]:
				if solucao[i] != dominio[i][0]:
					vizinhos.append(solucao[0:i] + [solucao[i] - 1] + solucao[i + 1:])
		atual = funcao_custo(solucao)
		melhor = atual
		for i in range(len(vizinhos)):
			custo = funcao_custo(vizinhos[i])
			if custo < melhor:
				melhor = custo
				solucao = vizinhos[i]

		if melhor == atual:
			break
	return solucao

#solucao_subida_encosta = subida_encosta(dominio, funcao_custo)
#custo_subida_encosta = funcao_custo(solucao_subida_encosta)
#imprimir_agenda(solucao_subida_encosta)

def tempera_simulada(dominio, funcao_custo, temperatura = 10000.0, restriamento = 0.95, passo = 1):
	solucao = [random.randint(dominio[i][0], dominio[i][1]) for i in range(len(dominio))]

	while temperatura > 0.1:
		i = random.randint(0, len(dominio) - 1)
		direcao = random.randint(-passo, passo)

		solucao_temp = solucao[:]
		solucao_temp[i] += direcao
		if solucao_temp[i] < dominio[i][0]:
			solucao_temp[i] = dominio[i][0]
		elif solucao_temp[i] > dominio[i][1]:
			solucao_temp[i] = dominio[1]

		custo_solucao = funcao_custo(solucao)
		custo_solucao_temp = funcao_custo(solucao_temp)
		probabilidade = pow(math.e, (-custo_solucao_temp - custo_solucao) / temperatura)

		if (custo_solucao_temp < custo_solucao or random.random() < probabilidade):
			solucao = solucao_temp

		temperatura = temperatura * restriamento
	return solucao

#solucao_tempera_simulada = tempera_simulada(dominio, funcao_custo)
#custo_subida_encosta = funcao_custo(solucao_tempera_simulada)
#imprimir_agenda(solucao_tempera_simulada)

def mutacao(dominio, passo, solucao):
	i = random.randint(0, len(dominio) - 1)
	mutante = solucao

	if random.random() <= 0.5:
		if solucao[i] != dominio[i][0]: 
			mutante = solucao[0:i] + [solucao[i] - passo] + solucao[i + 1:]
	else:
		if solucao[i] != dominio[i][1]:
			mutante = solucao[0:i] + [solucao[i] + passo] + solucao[i + 1:]
	return mutante

s = [1,4, 3,2, 7,3, 6,3, 2,4, 5,3]
s1 = mutacao(dominio, 1, s)

print(s)
print(s1)

def cruzamento(dominio, solucao1, solucao2):
	i = random.randint(1, len(dominio) - 2)
	return solucao1[0:i] + solucao2[i:]

s1 = [1,4, 3,2, 7,3, 6,3, 2,4, 5,3]
s2 = [0,1, 2,5, 8,9, 2,3, 5,1, 0,6]

s3 = cruzamento(dominio, s1, s2)

print(s3)

def genetico(dominio, funcao_custo, tamanho_polulacao = 50, passo = 1, probabilidade_mutacao = 0.2, elitismo = 0.2, numero_geracoes = 100):
	populacao = []
	for i in range(tamanho_polulacao):
		solucao = [random.randint(dominio[i][0]) for i in range(len(dominio))]
		populacao.append(solucao)

	numero_elitismo = int(elitismo * tamanho_polulacao)

	for i in range(numero_geracoes):
		custos = [(funcao_custo(individuo), individuo) for individuo in populacao]
		custos.sort()
		individuos_ordenados = [individuo for (custo, individuo) in custos]

		populacao = individuos_ordenados[0:numero_elitismo]

		while len(populacao) < tamanho_polulacao:
			if random.random() < probabilidade_mutacao:
				m = random.randint(0, numero_elitismo)
				populacao.append(mutacao(dominio, passo, individuos_ordenados[m]))
			else:
				c1 = random.randint(0, numero_elitismo)
				c2 = random.randint(0, numero_elitismo)
				populacao.append(cruzamento(dominio, individuos_ordenados[c1], individuos_ordenados[c2]))

	return custos[0][1]

#solucao_genetico = genetico(dominio, funcao_custo)
#custo_genetico = funcao_custo(solucao_genetico
#imprimir_agenda(solucao_genetico)

print("\na")
# ---------- end python ----------
python_2 = PythonScript()  # -> out, a
# ---------- python_2: Python ----------
"""
curso: algoritmos geneticos em python
plataforma: udemy
sobre: Construa passo a passo um algoritmo de Inteligência 
       Artificial aplicado no cenário de transporte de produtos!
"""

from random import random
#import matplotlib.pyplot as plt

class Produto():
	def __init__(self, nome, espaco, valor):
		self.nome = nome
		self.espaco = espaco
		self.valor = valor

class Individuo():
	def __init__(self, espacos, valores, limite_espacos, geracao=0):
		self.espacos = espacos
		self.valores = valores
		self.limite_espacos = limite_espacos
		self.nota_avaliacao = 0
		self.espaco_usado = 0
		self.geracao = geracao
		self.cromossomo = []

		for i in range(len(espacos)):
			if random() < 0.5:
				self.cromossomo.append("0")
			else:
				self.cromossomo.append("1")

	def avaliacao(self):
		nota = 0
		soma_espacos = 0
		for i in range(len(self.cromossomo)):
			if self.cromossomo[i]  == "1":
				nota += self.valores[i]
				soma_espacos += self.espacos[i]
		if soma_espacos >self.limite_espacos:
			nota = 1
		self.nota_avaliacao = nota 
		self.espaco_usado = soma_espacos

	def crossover(self, outro_individuo):
		corte = round(random() * len(self.cromossomo))

		filho1 = outro_individuo.cromossomo[0:corte] + self.cromossomo[corte::]
		filho2 = self.cromossomo[0:corte] + outro_individuo.cromossomo[corte::]

		filhos = [Individuo(self.espacos, self.valores, self.limite_espacos, self.geracao + 1),
		Individuo(self.espacos, self.valores, self.limite_espacos, self.geracao + 1)]
		filhos[0].cromossomo = filho1
		filhos[1].cromossomo = filho2
		return filhos

	def mutacao(self, taxa_mutacao):
		#print("Antes %s" % self.cromossomo)
		for i in range(len(self.cromossomo)):
			if random() < taxa_mutacao:
				if self.cromossomo[i] == "1":
					self.cromossomo[i] = "0"
				else:
					self.cromossomo[i] =="1"
		#print("Depois %s " %self.cromossomo)
		return self

class AlgoritmoGenetico():
	def __init__(self, tamanho_populacao):
		self.tamanho_populacao = tamanho_populacao
		self.populacao = []
		self.geracao = 0
		self.melhor_solucao = 0
		self.lista_solucoes = [] #lista que vamos plotar

	def inicializa_populacao(self, espacos, valores, limite_espacos):
		for i in range(self.tamanho_populacao):
			self.populacao.append(Individuo(espacos, valores, limite_espacos))
		self.melhor_solucao = self.populacao[0]

	def ordena_populacao(self):
		self.populacao = sorted(self.populacao, key = lambda populacao: populacao.nota_avaliacao, reverse = True)

	def melhor_individuo(self, individuo):
		if individuo.nota_avaliacao > self.melhor_solucao.nota_avaliacao:
			self.melhor_solucao = individuo

	def soma_avaliacoes(self):
		soma = 0
		for individuo in self.populacao:
			soma += individuo.nota_avaliacao
		return soma
	
	def seleciona_pai(self, soma_avaliacao):
		pai = -1
		valor_sorteado = random() * soma_avaliacao
		soma = 0
		i = 0
		while i < len(self.populacao) and soma < valor_sorteado:
			soma += self.populacao[i].nota_avaliacao
			pai += 1
			i += 1
		return pai

	def visualiza_geracao(self):
		melhor = self.populacao[0]
		print("Geração = %s --> Valor = %s Espaço = %s Cromosso = %s" % (self.populacao[0].geracao, 
			                                                             melhor.nota_avaliacao, 
			                                                             melhor.espaco_usado, 
			                                                             melhor.cromossomo))

	def resolver(self, taxa_mutacao, numero_geracoes, espacos, valores, limite_espacos):
		self.inicializa_populacao(espacos, valores, limite_espacos)

		for individuo in self.populacao:
			individuo.avaliacao()

		self.ordena_populacao()
		self.melhor_solucao = self.populacao[0]
		self.lista_solucoes.append(self.melhor_solucao.nota_avaliacao)

		self.visualiza_geracao()

		for geracao in range(numero_geracoes):
			soma_avaliacao = self.soma_avaliacoes()
			nova_populacao = []

			for individuos_gerados in range(0, self.tamanho_populacao, 2):
				pai1 = self.seleciona_pai(soma_avaliacao)
				pai2 = self.seleciona_pai(soma_avaliacao)

				filhos = self.populacao[pai1].crossover(self.populacao[pai2])

				nova_populacao.append(filhos[0].mutacao(taxa_mutacao))
				nova_populacao.append(filhos[1].mutacao(taxa_mutacao))

			self.populacao = list(nova_populacao)

			for individuo in self.populacao:
				individuo.avaliacao()

			self.ordena_populacao()

			melhor = self.populacao[0]
			self.lista_solucoes.append(melhor.nota_avaliacao)
			self.melhor_individuo(melhor)

		print("\nMelhor solução = G: %s Valor: %s Espaço: %s Cromosso: %s" % (self.melhor_solucao.geracao, self.melhor_solucao.nota_avaliacao, self.melhor_solucao.limite_espacos, self.melhor_solucao.cromossomo))

		return self.melhor_solucao.cromossomo

"""
if __name__ == '__main__':
	#p1 = Produto("Iphone 6", 0.0000899, 2199.12)
	lista_produtos = []
	lista_produtos.append(Produto("Geladeira dako", 0.751, 999.90))
	lista_produtos.append(Produto("Iphone 6", 0.0000899, 2911.12))
	lista_produtos.append(Produto("TV 55", 0.400, 4345.99))
	lista_produtos.append(Produto("TV 42", 0.200, 2999.00))
	lista_produtos.append(Produto("Notebook Dell", 0.00350, 2499.90))
	lista_produtos.append(Produto("Notebook Asus", 0.527, 3999.00))
	lista_produtos.append(Produto("Ventilador Panasonic", 0.496, 199.90))
	lista_produtos.append(Produto("Microondas Eletrolux", 0.0496, 308.66))
	lista_produtos.append(Produto("Microondas LG", 0.0544, 429.90))
	lista_produtos.append(Produto("Geladeira Brastemp", 0.635, 849.00))
	lista_produtos.append(Produto("Geladeira Consul", 0.870, 1199.00))

	#for produto in lista_produtos:
	#	print(produto.nome)

	espacos = []
	valores = []
	nomes = []
	for produto in lista_produtos:
		espacos.append(produto.espaco)
		valores.append(produto.valor)
		nomes.append(produto.nome)
	limite = 3 #podemos carregar três metros cubicos
	tamanho_populacao = 20
	taxa_mutacao = 0.02 #primeiros testes foram realizados com 0.01
	numero_geracoes = 200 #primeiros testes foram realizados com 100
	ag = AlgoritmoGenetico(tamanho_populacao)
	resultado = ag.resolver(taxa_mutacao, numero_geracoes, espacos, valores, limite)
	for i in range(len(lista_produtos)):
		if resultado[i] == 1:
			print("Nome: %s R$: %s " %(lista_produtos[i].nome, 
				                       lista_produtos[i].valor))

	#for valor in ag.lista_solucoes:
	#	print(valor)
	#plt.plot(ag.lista_solucoes)
	#plt.title("Acompanhamento dos valores")
	#plt.show()
#por que não está imprimindo todas as gerações???	

"""
# ---------- end python_2 ----------
python_3 = PythonScript()  # -> out, a
# ---------- python_3: Python ----------
"""
curso: algoritmos geneticos em python
plataforma: udemy
sobre: Construa passo a passo um algoritmo de Inteligência 
       Artificial aplicado no cenário de transporte de produtos!
"""

from random import random
#import matplotlib.pyplot as plt

class Produto():
	def __init__(self, nome, espaco, valor):
		self.nome = nome
		self.espaco = espaco
		self.valor = valor

class Individuo():
	def __init__(self, espacos, valores, limite_espacos, geracao=0):
		self.espacos = espacos
		self.valores = valores
		self.limite_espacos = limite_espacos
		self.nota_avaliacao = 0
		self.espaco_usado = 0
		self.geracao = geracao
		self.cromossomo = []

		for i in range(len(espacos)):
			if random() < 0.5:
				self.cromossomo.append("0")
			else:
				self.cromossomo.append("1")

	def avaliacao(self):
		nota = 0
		soma_espacos = 0
		for i in range(len(self.cromossomo)):
			if self.cromossomo[i]  == "1":
				nota += self.valores[i]
				soma_espacos += self.espacos[i]
		if soma_espacos >self.limite_espacos:
			nota = 1
		self.nota_avaliacao = nota 
		self.espaco_usado = soma_espacos

	def crossover(self, outro_individuo):
		corte = round(random() * len(self.cromossomo))

		filho1 = outro_individuo.cromossomo[0:corte] + self.cromossomo[corte::]
		filho2 = self.cromossomo[0:corte] + outro_individuo.cromossomo[corte::]

		filhos = [Individuo(self.espacos, self.valores, self.limite_espacos, self.geracao + 1),
		Individuo(self.espacos, self.valores, self.limite_espacos, self.geracao + 1)]
		filhos[0].cromossomo = filho1
		filhos[1].cromossomo = filho2
		return filhos

	def mutacao(self, taxa_mutacao):
		#print("Antes %s" % self.cromossomo)
		for i in range(len(self.cromossomo)):
			if random() < taxa_mutacao:
				if self.cromossomo[i] == "1":
					self.cromossomo[i] = "0"
				else:
					self.cromossomo[i] =="1"
		#print("Depois %s " %self.cromossomo)
		return self

class AlgoritmoGenetico():
	def __init__(self, tamanho_populacao):
		self.tamanho_populacao = tamanho_populacao
		self.populacao = []
		self.geracao = 0
		self.melhor_solucao = 0
		self.lista_solucoes = [] #lista que vamos plotar

	def inicializa_populacao(self, espacos, valores, limite_espacos):
		for i in range(self.tamanho_populacao):
			self.populacao.append(Individuo(espacos, valores, limite_espacos))
		self.melhor_solucao = self.populacao[0]

	def ordena_populacao(self):
		self.populacao = sorted(self.populacao, key = lambda populacao: populacao.nota_avaliacao, reverse = True)

	def melhor_individuo(self, individuo):
		if individuo.nota_avaliacao > self.melhor_solucao.nota_avaliacao:
			self.melhor_solucao = individuo

	def soma_avaliacoes(self):
		soma = 0
		for individuo in self.populacao:
			soma += individuo.nota_avaliacao
		return soma
	
	def seleciona_pai(self, soma_avaliacao):
		pai = -1
		valor_sorteado = random() * soma_avaliacao
		soma = 0
		i = 0
		while i < len(self.populacao) and soma < valor_sorteado:
			soma += self.populacao[i].nota_avaliacao
			pai += 1
			i += 1
		return pai

	def visualiza_geracao(self):
		melhor = self.populacao[0]
		print("Geração = %s --> Valor = %s Espaço = %s Cromosso = %s" % (self.populacao[0].geracao, 
			                                                             melhor.nota_avaliacao, 
			                                                             melhor.espaco_usado, 
			                                                             melhor.cromossomo))

	def resolver(self, taxa_mutacao, numero_geracoes, espacos, valores, limite_espacos):
		self.inicializa_populacao(espacos, valores, limite_espacos)

		for individuo in self.populacao:
			individuo.avaliacao()

		self.ordena_populacao()
		self.melhor_solucao = self.populacao[0]
		self.lista_solucoes.append(self.melhor_solucao.nota_avaliacao)

		self.visualiza_geracao()

		for geracao in range(numero_geracoes):
			soma_avaliacao = self.soma_avaliacoes()
			nova_populacao = []

			for individuos_gerados in range(0, self.tamanho_populacao, 2):
				pai1 = self.seleciona_pai(soma_avaliacao)
				pai2 = self.seleciona_pai(soma_avaliacao)

				filhos = self.populacao[pai1].crossover(self.populacao[pai2])

				nova_populacao.append(filhos[0].mutacao(taxa_mutacao))
				nova_populacao.append(filhos[1].mutacao(taxa_mutacao))

			self.populacao = list(nova_populacao)

			for individuo in self.populacao:
				individuo.avaliacao()

			self.ordena_populacao()

			melhor = self.populacao[0]
			self.lista_solucoes.append(melhor.nota_avaliacao)
			self.melhor_individuo(melhor)

		print("\nMelhor solução = G: %s Valor: %s Espaço: %s Cromosso: %s" % (self.melhor_solucao.geracao, self.melhor_solucao.nota_avaliacao, self.melhor_solucao.limite_espacos, self.melhor_solucao.cromossomo))

		return self.melhor_solucao.cromossomo


if __name__ == '__main__':
	#p1 = Produto("Iphone 6", 0.0000899, 2199.12)
	lista_produtos = []
	lista_produtos.append(Produto("Geladeira dako", 0.751, 999.90))
	lista_produtos.append(Produto("Iphone 6", 0.0000899, 2911.12))
	lista_produtos.append(Produto("TV 55", 0.400, 4345.99))
	lista_produtos.append(Produto("TV 42", 0.200, 2999.00))
	lista_produtos.append(Produto("Notebook Dell", 0.00350, 2499.90))
	lista_produtos.append(Produto("Notebook Asus", 0.527, 3999.00))
	lista_produtos.append(Produto("Ventilador Panasonic", 0.496, 199.90))
	lista_produtos.append(Produto("Microondas Eletrolux", 0.0496, 308.66))
	lista_produtos.append(Produto("Microondas LG", 0.0544, 429.90))
	lista_produtos.append(Produto("Geladeira Brastemp", 0.635, 849.00))
	lista_produtos.append(Produto("Geladeira Consul", 0.870, 1199.00))

	#for produto in lista_produtos:
	#	print(produto.nome)

	espacos = []
	valores = []
	nomes = []
	for produto in lista_produtos:
		espacos.append(produto.espaco)
		valores.append(produto.valor)
		nomes.append(produto.nome)
	limite = 3 #podemos carregar três metros cubicos
	tamanho_populacao = 20
	taxa_mutacao = 0.02 #primeiros testes foram realizados com 0.01
	numero_geracoes = 200 #primeiros testes foram realizados com 100
	ag = AlgoritmoGenetico(tamanho_populacao)
	resultado = ag.resolver(taxa_mutacao, numero_geracoes, espacos, valores, limite)
	for i in range(len(lista_produtos)):
		if resultado[i] == 1:
			print("Nome: %s R$: %s " %(lista_produtos[i].nome, 
				                       lista_produtos[i].valor))

	#for valor in ag.lista_solucoes:
	#	print(valor)
	#plt.plot(ag.lista_solucoes)
	#plt.title("Acompanhamento dos valores")
	#plt.show()
#por que não está imprimindo todas as gerações???
# ---------- end python_3 ----------
