# Grasshopper definition GA_02.gh (Grasshopper 1.0.7)

toggle = BooleanToggle(True)
ghpython_script = GhPythonScript(Toggle=toggle)  # -> out, resultado
# ---------- ghpython_script: Python ----------
__author__ = "Renato Godoi da Cruz"
__version__ = "2020.08.20"


import rhinoscriptsyntax as rs

from random import random, randint

class Parametro():
    """No Grasshopper, todo paamêtro tem 1 nome e um valor que vai de um min até um max."""
    def __init__(self, nome, minimo, maximo):    #o valor entra nesse algoritmo
        self.nome = nome                         #parametro nome. Ex.: largura
        self.minimo = minimo                     #parametro min. Ex.: 1
        self.maximo = maximo                     #parametro max. Ex.: 10

#o cromossomo (str) será o conjuntos dos valores (escolhidos entre o min e o max)
#o individuo será o próprio cromossomo
class Individuo():
    """Definição"""
    def __init__(self, minimos, maximos, geracao=0):
        self.minimos = minimos
        self.maximos = maximos
        self.nota_avaliacao = 0
        self.geracao = geracao
        self.cromossomo = []                     #valores entre min e max dos parametros

        for i in range(len(lista_parametros)):   #escolher valores entre min e max aleatoriamente
            if (type(minimos[i]) == float) and (type(maximos[i]) == float):
                self.cromossomo.append(random.uniform(minimos[i], maximos[i])) #instance
            else:
                self.cromossomo.append(randint(minimos[i], maximos[i])) 

    def avaliacao(self):
        """Função fitness"""
        #Aqui deve receber o valor_objetivo de cada individuo (vem do modelo) Por exemplo, relação área/volume
        nota =randint(1000, 2222) #função provisório para continuar o desenv. script
        self.nota_avaliacao = nota

    def crossover(self, outro_individuo):
        """Determina o ponto de crossover"""
        corte = int(round(random()  * len(self.cromossomo))) #um número randômico (0 ou 1) vai multiplicar pelo tamanho do cromossomo (round é para arredondar)

        
        filho1 = outro_individuo.cromossomo[0:corte] + self.cromossomo[corte::]  #o filho recebe parte do cromossomo (de 0 até corte) do outro indíviduo
        filho2 = self.cromossomo[0:corte] + outro_individuo.cromossomo[corte::]  #o outro_ind é o individuo2 

        filhos = [Individuo(self.minimos, self.maximos, self.geracao + 1),
                  Individuo(self.minimos, self.maximos, self.geracao + 1)]
        filhos[0].cromossomo = filho1   #filho 1 e 2 na verdade está criando cromossomos
        filhos[1].cromossomo = filho2
        return filhos

    def mutacao(self, taxa_mutacao):
        """Determina a mutação dos cromossomos""" 
        for i in range(len(self.cromossomo)):
            if random() < taxa_mutacao:
                if (type(minimos[i]) == float) and (type(maximos[i]) == float):
                    self.cromossomo[i] = random.uniform(minimos[i], maximos[i]) #instance
                else:
                    self.cromossomo[i] = randint(minimos[i], maximos[i]) 
        return self

class AlgoritmoGenetico():
    def __init__(self, tamanho_populacao):
        self.tamanho_populacao = tamanho_populacao
        self.populacao = []
        self.geracao = 0
        self.melhor_solucao = 0

    def inicializa_populacao(self, minimos, maximos):
        for i in range(self.tamanho_populacao):
            self.populacao.append(Individuo(minimos, maximos))
        self.melhor_solucao = self.populacao[0] 

    def ordena_populacao(self):
        #AQUI DEVE ENTRAR SE É MINIMIZAÇÃO OU MAXIMIZAÇÃO
        self.populacao = sorted(self.populacao,
                                key = lambda populacao: populacao.nota_avaliacao,
                                reverse = True) 
        """
        self.populacao = sorted(self.populacao,
                                key = lambda populacao: populacao.nota_avaliacao)
        """

        #HÁ ALTERAÇÃO NOS VALORES, MAS AINDA NÃO ENTENDO SE ESTÁ BOM OU NÃO :/
        #AINDA A MELHOR SOLUÇÃO NÃO É O MENOR NÚMERO




    def melhor_individuo(self, individuo):
        if individuo.nota_avaliacao > self.melhor_solucao.nota_avaliacao:
            self.melhor_solucao = individuo

    def soma_avaliacoes(self):
        soma = 0
        for individuo in self.populacao:
            soma += individuo.nota_avaliacao
        return soma

    def seleciona_pai(self, soma_avaliacao):
        """Seleção dos indivíduos - método Roleta Viciada"""
        pai = -1
        valor_sorteado = random() * soma_avaliacao
        soma = 0
        i = 0
        while i < len(self.populacao) and soma < valor_sorteado:
            soma += self.populacao[i].nota_avaliacao
            pai += 1
            i += 1
        return pai


#AQUI PRECISA SAÍR COMO INPUT E NÃO COMO IMPRESSÃO

    def visualiza_geracao(self): #DADOS DO GA(raspar para uma planilha Excel)
        melhor = self.populacao[0]
        saida = melhor.cromossomo
        print(saida) #COMO FAZER ISSO SAIR POR OUTPUT?????
        return saida
        #print("G:%s --> Valor: %s Cromossomo: %s" % (self.populacao[0].geracao,
                                                     #melhor.nota_avaliacao,
                                                     #melhor.cromossomo))

#ACIMA TAMBÉM DEVE SER O RASPADOR DE DADOS


    def resolver(self, taxa_mutacao, numero_geracao):
        self.inicializa_populacao(minimos, maximos)

        for individuo in self.populacao:                #primeira geração (aleatória)
            individuo.avaliacao()

        self.ordena_populacao()
        self.visualiza_geracao()

        for geracao in range(numero_geracao):           #gerações novas
            soma_avaliacao = self.soma_avaliacoes()
            nova_populacao = []

            for individuos_gerados in range(0, self.tamanho_populacao, 2):
                pai1 = self.seleciona_pai(soma_avaliacao)
                pai2 = self.seleciona_pai(soma_avaliacao)

                filhos = self.populacao[pai1].crossover(self.populacao[pai2])

                nova_populacao.append(filhos[0].mutacao(taxa_mutacao))
                nova_populacao.append(filhos[1].mutacao(taxa_mutacao))

            self.populacao = list(nova_populacao)

            for individuo in self.populacao:
                individuo.avaliacao()

            self.ordena_populacao()
            self.visualiza_geracao()

            melhor = self.populacao[0]
            self.melhor_individuo(melhor)
        
        print("\nMelhor solução -> G: %s Valor: %s Cromossomo: %s" %
              (self.melhor_solucao.geracao,
               self.melhor_solucao.nota_avaliacao,
               self.melhor_solucao.cromossomo))
        
        return self.melhor_solucao.cromossomo


if Toggle: #método __main__

    lista_parametros = []
    lista_parametros.append(Parametro('Altura', 1, 5))
    lista_parametros.append(Parametro('Largura', 6, 10))
    lista_parametros.append(Parametro('Profundidade', 11, 20))
    #for parametro in lista_parametros:
        #print(parametro.nome)

    minimos = []
    maximos = []
    nomes = []
    for parametro in lista_parametros:       
        minimos.append(parametro.minimo)
        maximos.append(parametro.maximo)
        nomes.append(parametro.nome)

    tamanho_populacao = 20
    taxa_mutacao = 0.05
    numero_geracao = 100
    ag = AlgoritmoGenetico(tamanho_populacao)

    #saida_inputs =           #AQUI DEVE INICILIZAR INPUTS PARA "EXPLODE TREE" PARA LIGAR AO MODELO
    #FUNÇÃO PARECIDA COM 'RESOLVER' OU BUSCAR NO 'INICILIZA' POPULAÇÃO, PARTE ALEATÓRIA

    #tipo um inicia = ag.saída #uma função para inicializar apenas um individuo para explodir as saídas

    resultado = ag.resolver(taxa_mutacao, numero_geracao)
# ---------- end ghpython_script ----------
ghpython_script_2 = GhPythonScript(Toggle=toggle)  # -> out, result
# ---------- ghpython_script_2: Python ----------
__author__ = "Renato Godoi da Cruz"
__version__ = "2020.08.20"


import rhinoscriptsyntax as rs

from random import random, randint

class Parameter():
    """No Grasshopper, todo paamêtro tem 1 nome e um valor que vai de um min até um max."""
    def __init__(self, name, minimum, maximum):    #o valor entra nesse algoritmo
        self.name = name                         #parametro nome. Ex.: largura
        self.minimum = minimum                     #parametro min. Ex.: 1
        self.maximum = maximum                     #parametro max. Ex.: 10

#o cromossomo (str) será o conjuntos dos valores (escolhidos entre o min e o max)
#o individuo será o próprio cromossomo
class Individual():
    """Definição"""
    def __init__(self, minimums, maximums, generation=0):
        self.minimums = minimums
        self.maximums = maximums
        self.grade_evaluation = 0
        self.generation = generation
        self.chromosome = []                     #valores entre min e max dos parametros

        for i in range(len(list_parameters)):   #escolher valores entre min e max aleatoriamente
            if (type(minimums[i]) == float) and (type(maximums[i]) == float):
                self.chromosome.append(random.uniform(minimums[i], maximums[i])) #instance
            else:
                self.chromosome.append(randint(minimums[i], maximums[i])) 

    def evaluation(self):
        """Função fitness"""
        #Aqui deve receber o valor_objetivo de cada individuo (vem do modelo) Por exemplo, relação área/volume
        grade =randint(1000, 2222) #função provisório para continuar o desenv. script #NOTA
        self.grade_evaluation = grade

    def crossover(self, another_individual):
        """Determina o ponto de crossover"""
        cut = int(round(random()  * len(self.chromosome))) #um número randômico (0 ou 1) vai multiplicar pelo tamanho do cromossomo (round é para arredondar)

        
        child1 = another_individual.chromosome[0:cut] + self.chromosome[cut::]  #o filho recebe parte do cromossomo (de 0 até corte) do outro indíviduo
        child2 = self.chromosome[0:cut] + another_individual.chromosome[cut::]  #o outro_ind é o individuo2 

        children = [Individual(self.minimums, self.maximums, self.generation + 1),
                  Individual(self.minimums, self.maximums, self.generation + 1)]
        children[0].chromosome = child1   #filho 1 e 2 na verdade está criando cromossomos
        children[1].chromosome = child2
        return children

    def mutation(self, mutation_rate):
        """Determina a mutação dos cromossomos""" 
        for i in range(len(self.chromosome)):
            if random() < mutation_rate:
                if (type(minimums[i]) == float) and (type(maximums[i]) == float):
                    self.chromosome[i] = random.uniform(minimums[i], maximums[i]) #instance
                else:
                    self.chromosome[i] = randint(minimums[i], maximums[i]) 
        return self

class GeneticAlgorithm():
    def __init__(self, population_size):
        self.population_size = population_size
        self.population = []
        self.generation = 0
        self.best_solution = 0

    def initializes_population(self, minimums, maximums):
        for i in range(self.population_size):
            self.population.append(Individual(minimums, maximums))
        self.best_solution = self.population[0] 

    def orders_population(self):
        #AQUI DEVE ENTRAR SE É MINIMIZAÇÃO OU MAXIMIZAÇÃO
        self.population = sorted(self.population,
                                key = lambda population: population.grade_evaluation,
                                reverse = True) 
        """
        self.population = sorted(self.population,
                                key = lambda population: population.grade_evaluation)
        """

        #HÁ ALTERAÇÃO NOS VALORES, MAS AINDA NÃO ENTENDO SE ESTÁ BOM OU NÃO :/
        #AINDA A MELHOR SOLUÇÃO NÃO É O MENOR NÚMERO

    def best_individual(self, individual):
        if individual.grade_evaluation > self.best_solution.grade_evaluation:
            self.best_solution = individual

    def sum_evaluation(self):
        sum = 0
        for individual in self.population:
            sum += individual.grade_evaluation
        return sum

    def select_father(self, sum_evaluation):
        """Seleção dos indivíduos - método Roleta Viciada"""
        father = -1
        value_drawn = random() * sum_evaluation #determina valor sorteado
        sum = 0
        i = 0
        while i < len(self.population) and sum < value_drawn:
            sum += self.population[i].grade_evaluation
            father += 1
            i += 1
        return father

#AQUI PRECISA SAÍR COMO OUTPUT E NÃO COMO IMPRESSÃO

    def view_generation(self): #DADOS DO GA(raspar para uma planilha Excel)
        best = self.population[0]
        output = best.chromosome
        print(output) #COMO FAZER ISSO SAIR POR OUTPUT?????
        return output
        #print("G:%s --> Valor: %s Cromossomo: %s" % (self.population[0].generation,
                                                     #best.grade_evaluation,
                                                     #best.chromosome))

#ACIMA TAMBÉM DEVE SER O RASPADOR DE DADOS

    def solve(self, mutation_rate, generation_number):
        self.initializes_population(minimums, maximums)

        for individual in self.population:                #primeira geração (aleatória)
            individual.evaluation()

        self.orders_population()
        self.view_generation()

        for generation in range(generation_number):           #gerações novas
            sum_evaluation = self.sum_evaluation()
            new_population = []

            for generated_individuals in range(0, self.population_size, 2):
                father1 = self.select_father(sum_evaluation)
                father2 = self.select_father(sum_evaluation)

                children = self.population[father1].crossover(self.population[father2])

                new_population.append(children[0].mutation(mutation_rate))
                new_population.append(children[1].mutation(mutation_rate))

            self.population = list(new_population)

            for individual in self.population:
                individual.evaluation()

            self.orders_population()
            self.view_generation()

            best = self.population[0]
            self.best_individual(best)
        
        print("\nMelhor solução -> G: %s Valor: %s Cromossomo: %s" %
              (self.best_solution.generation,
               self.best_solution.grade_evaluation,
               self.best_solution.chromosome))
        
        return self.best_solution.chromosome


if Toggle: #método __main__

    list_parameters = []
    list_parameters.append(Parameter('Altura', 1, 5))
    list_parameters.append(Parameter('Largura', 6, 10))
    list_parameters.append(Parameter('Profundidade', 11, 20))
    #for paramater in list_parameters:
        #print(parameter.names)

    minimums = []
    maximums = []
    names = []
    for parameter in list_parameters:       
        minimums.append(parameter.minimum)
        maximums.append(parameter.maximum)
        names.append(parameter.name)

    population_size = 20
    mutation_rate = 0.05
    generation_number = 100
    ag = GeneticAlgorithm(population_size)

    #saida_inputs =           #AQUI DEVE INICILIZAR INPUTS PARA "EXPLODE TREE" PARA LIGAR AO MODELO
    #FUNÇÃO PARECIDA COM 'RESOLVER' OU BUSCAR NO 'INICILIZA' POPULAÇÃO, PARTE ALEATÓRIA

    #tipo um inicia = ag.saída #uma função para inicializar apenas um individuo para explodir as saídas

    result = ag.solve(mutation_rate, generation_number)
# ---------- end ghpython_script_2 ----------
data_recorder = DataRecorder(ghpython_script_2.result, DataLimit=-10, RecordData=True)
ghpython_script_3 = GhPythonScript(Toggle=toggle)  # -> out, resultado
# ---------- ghpython_script_3: Python ----------
__author__ = "Renato Godoi da Cruz"
__version__ = "2020.08.20"


import rhinoscriptsyntax as rs

from random import random, randint

class Parametro():
    """No Grasshopper, todo paamêtro tem 1 nome e um valor que vai de um min até um max."""
    def __init__(self, nome, minimo, maximo):    #o valor entra nesse algoritmo
        self.nome = nome                         #parametro nome. Ex.: largura
        self.minimo = minimo                     #parametro min. Ex.: 1
        self.maximo = maximo                     #parametro max. Ex.: 10

#o cromossomo (str) será o conjuntos dos valores (escolhidos entre o min e o max)
#o individuo será o próprio cromossomo
class Individuo():
    """Definição"""
    def __init__(self, minimos, maximos, geracao=0):
        self.minimos = minimos
        self.maximos = maximos
        self.nota_avaliacao = 0
        self.geracao = geracao
        self.cromossomo = []                     #valores entre min e max dos parametros

        for i in range(len(lista_parametros)):   #escolher valores entre min e max aleatoriamente
            if (type(minimos[i]) == float) and (type(maximos[i]) == float):
                self.cromossomo.append(random.uniform(minimos[i], maximos[i])) #instance
            else:
                self.cromossomo.append(randint(minimos[i], maximos[i])) 

    def avaliacao(self):
        """Função fitness"""
        #Aqui deve receber o valor_objetivo de cada individuo (vem do modelo) Por exemplo, relação área/volume
        nota =randint(1000, 2222) #função provisório para continuar o desenv. script
        self.nota_avaliacao = nota

    def crossover(self, outro_individuo):
        """Determina o ponto de crossover"""
        corte = int(round(random()  * len(self.cromossomo))) #um número randômico (0 ou 1) vai multiplicar pelo tamanho do cromossomo (round é para arredondar)

        
        filho1 = outro_individuo.cromossomo[0:corte] + self.cromossomo[corte::]  #o filho recebe parte do cromossomo (de 0 até corte) do outro indíviduo
        filho2 = self.cromossomo[0:corte] + outro_individuo.cromossomo[corte::]  #o outro_ind é o individuo2 

        filhos = [Individuo(self.minimos, self.maximos, self.geracao + 1),
                  Individuo(self.minimos, self.maximos, self.geracao + 1)]
        filhos[0].cromossomo = filho1   #filho 1 e 2 na verdade está criando cromossomos
        filhos[1].cromossomo = filho2
        return filhos

    def mutacao(self, taxa_mutacao):
        """Determina a mutação dos cromossomos""" 
        for i in range(len(self.cromossomo)):
            if random() < taxa_mutacao:
                if (type(minimos[i]) == float) and (type(maximos[i]) == float):
                    self.cromossomo[i] = random.uniform(minimos[i], maximos[i]) #instance
                else:
                    self.cromossomo[i] = randint(minimos[i], maximos[i]) 
        return self

class AlgoritmoGenetico():
    def __init__(self, tamanho_populacao):
        self.tamanho_populacao = tamanho_populacao
        self.populacao = []
        self.geracao = 0
        self.melhor_solucao = 0

    def inicializa_populacao(self, minimos, maximos):
        for i in range(self.tamanho_populacao):
            self.populacao.append(Individuo(minimos, maximos))
        self.melhor_solucao = self.populacao[0] 

    def ordena_populacao(self):
        #AQUI DEVE ENTRAR SE É MINIMIZAÇÃO OU MAXIMIZAÇÃO
        self.populacao = sorted(self.populacao,
                                key = lambda populacao: populacao.nota_avaliacao,
                                reverse = True) 
        """
        self.populacao = sorted(self.populacao,
                                key = lambda populacao: populacao.nota_avaliacao)
        """

        #HÁ ALTERAÇÃO NOS VALORES, MAS AINDA NÃO ENTENDO SE ESTÁ BOM OU NÃO :/
        #AINDA A MELHOR SOLUÇÃO NÃO É O MENOR NÚMERO




    def melhor_individuo(self, individuo):
        if individuo.nota_avaliacao > self.melhor_solucao.nota_avaliacao:
            self.melhor_solucao = individuo

    def soma_avaliacoes(self):
        soma = 0
        for individuo in self.populacao:
            soma += individuo.nota_avaliacao
        return soma

    def seleciona_pai(self, soma_avaliacao):
        """Seleção dos indivíduos - método Roleta Viciada"""
        pai = -1
        valor_sorteado = random() * soma_avaliacao
        soma = 0
        i = 0
        while i < len(self.populacao) and soma < valor_sorteado:
            soma += self.populacao[i].nota_avaliacao
            pai += 1
            i += 1
        return pai


#AQUI PRECISA SAÍR COMO INPUT E NÃO COMO IMPRESSÃO

    def visualiza_geracao(self): #DADOS DO GA(raspar para uma planilha Excel)
        melhor = self.populacao[0]
        saida = melhor.cromossomo
        print(saida) #COMO FAZER ISSO SAIR POR OUTPUT?????
        return saida
        #print("G:%s --> Valor: %s Cromossomo: %s" % (self.populacao[0].geracao,
                                                     #melhor.nota_avaliacao,
                                                     #melhor.cromossomo))


####################################################
    def visualiza_todos_individuos(self):
        for i in self.populacao:
            print i

#ACIMA TAMBÉM DEVE SER O RASPADOR DE DADOS
######################################################



    def resolver(self, taxa_mutacao, numero_geracao):
        self.inicializa_populacao(minimos, maximos)

        for individuo in self.populacao:                #primeira geração (aleatória)
            individuo.avaliacao()

        self.ordena_populacao()
        self.visualiza_geracao()
        self.visualiza_todos_individuos()

        for geracao in range(numero_geracao):           #gerações novas
            soma_avaliacao = self.soma_avaliacoes()
            nova_populacao = []

            for individuos_gerados in range(0, self.tamanho_populacao, 2):
                pai1 = self.seleciona_pai(soma_avaliacao)
                pai2 = self.seleciona_pai(soma_avaliacao)

                filhos = self.populacao[pai1].crossover(self.populacao[pai2])

                nova_populacao.append(filhos[0].mutacao(taxa_mutacao))
                nova_populacao.append(filhos[1].mutacao(taxa_mutacao))

            self.populacao = list(nova_populacao)

            for individuo in self.populacao:
                individuo.avaliacao()

            self.ordena_populacao()
            self.visualiza_geracao()
            self.visualiza_todos_individuos()

            melhor = self.populacao[0]
            self.melhor_individuo(melhor)
        
        print("\nMelhor solução -> G: %s Valor: %s Cromossomo: %s" %
              (self.melhor_solucao.geracao,
               self.melhor_solucao.nota_avaliacao,
               self.melhor_solucao.cromossomo))
        
        return self.melhor_solucao.cromossomo


if Toggle: #método __main__

    lista_parametros = []
    lista_parametros.append(Parametro('Altura', 1, 5))
    lista_parametros.append(Parametro('Largura', 6, 10))
    lista_parametros.append(Parametro('Profundidade', 11, 20))
    #for parametro in lista_parametros:
        #print(parametro.nome)

    minimos = []
    maximos = []
    nomes = []
    for parametro in lista_parametros:       
        minimos.append(parametro.minimo)
        maximos.append(parametro.maximo)
        nomes.append(parametro.nome)

    tamanho_populacao = 20
    taxa_mutacao = 0.05
    numero_geracao = 100
    ag = AlgoritmoGenetico(tamanho_populacao)

    #saida_inputs =           #AQUI DEVE INICILIZAR INPUTS PARA "EXPLODE TREE" PARA LIGAR AO MODELO
    #FUNÇÃO PARECIDA COM 'RESOLVER' OU BUSCAR NO 'INICILIZA' POPULAÇÃO, PARTE ALEATÓRIA

    #tipo um inicia = ag.saída #uma função para inicializar apenas um individuo para explodir as saídas

    resultado = ag.resolver(taxa_mutacao, numero_geracao)
# ---------- end ghpython_script_3 ----------
panel = Panel(ghpython_script.out)
panel_2 = Panel(ghpython_script.resultado)
panel_3 = Panel(ghpython_script_2.out)
param_viewer = ParamViewer(ghpython_script_2.result)
panel_4 = Panel(ghpython_script_2.result)
panel_5 = Panel(ghpython_script_3.out)
panel_6 = Panel(ghpython_script_3.resultado)
