# Grasshopper definition hello_world_ghpython.gh (Grasshopper 0.9.76)
# plug-ins: Python Interpreter

# # File: guessPassword.py
# #    from chapter 1 of _Genetic Algorithms with Python_, an ebook
# #    for sale at http://leanpub.com/genetic_algorithms_with_python
# #
# # Author: Clinton Sheppard <fluentcoder@gmail.com>
# # Repository: https://repl.it/CZL1/1
# # Copyright (c) 2016 Clinton Sheppard
# #
# # Licensed under the Apache License, Version 2.0 (the "License").
# # You may not use this file except in compliance with the License.
# # You may obtain a copy of the License at
# #   http://www.apache.org/licenses/LICENSE-2.0
# #
# # Unless required by applicable law or agreed to in writing, software
# # distributed under the License is distributed on an "AS IS" BASIS,
# # WITHOUT WARRANTIES OR CONDITIONS OF ANY KIND, either express or
# # implied.  See the License for the specific language governing
# # permissions and limitations under the License.
panel = Panel("\" abcdefghijklmnopqrstuvwxyzABCDEFGHIJKLMNOPQRSTUVWXYZ!.\"")
python = PythonScript(Toggle=Toggle(True), geneSet=panel, target="\"Noiz eh loko\"")  # -> out, a
# ---------- python: Python ----------
import random
import datetime

def get_fitness(guess):
    return sum(1 for expected, actual in zip(target, guess)
               if expected == actual)

def display(guess):
    timeDiff = datetime.datetime.now() - startTime
    fitness = get_fitness(guess)
    print("{0}\t{1}\t{2}".format(guess, fitness, str(timeDiff)))

def generate_parent(length):
    genes = []
    while len(genes) < length:
        sampleSize = min(length - len(genes), len(geneSet))
        genes.extend(random.sample(geneSet, sampleSize))
    return ''.join(genes)

def mutate(parent):
    index = random.randrange(0, len(parent))
    childGenes = list(parent)
    newGene, alternate = random.sample(geneSet, 2)
    childGenes[index] = alternate \
        if newGene == childGenes[index] \
        else newGene
    return ''.join(childGenes)

random.seed()
#geneSet = " abcdefghijklmnopqrstuvwxyzABCDEFGHIJKLMNOPQRSTUVWXYZ!."
#target = "Hello World!"
startTime = datetime.datetime.now()
bestParent = generate_parent(len(target))
bestFitness = get_fitness(bestParent)
display(bestParent)

while Toggle:
    child = mutate(bestParent)
    childFitness = get_fitness(child)
    if bestFitness >= childFitness:
        continue
    display(child)
    if childFitness >= len(bestParent):
        break
    bestFitness = childFitness
    bestParent = child
# ---------- end python ----------
panel_2 = Panel(python.out)
