# Dynamo graph Optimization Example-02-SCH.dyn (Dynamo 0.7.6.3982)

# note: Visulizes the Pareto Optimal Set

# note: Saves the results to a CSV file.
file_path = Filename("C:\Users\t_aslm\Desktop\gbXML\MOO SCH.csv")
code_block = CodeBlock { 1; }
# note: Read more about Optimo and how to use it on https://github.com/BPOpt/Optimo
population_size = CodeBlock { 100; }
number_of_objecctives = CodeBlock { 2; }
lower_limit = CodeBlock { -10; }
lower_limit_list = List.Create(lower_limit)
upper_limit = CodeBlock { 12; }
upper_limit_list = List.Create(upper_limit)
initialSolutionList = Optimo.NSGA_II.InitialSolutionList(population_size, number_of_objecctives, lower_limit_list, upper_limit_list)
sch_fitness_function_1 = Custom[SCH Fitness Function-1]()  # The Fitness Function for Optimo's SCH Example
sch_fitness_function_2 = Custom[SCH Fitness Function-2]()  # The Fitness Function for Optimo's SCH Example
list_of_fitness_functions = List.Create(sch_fitness_function_1, sch_fitness_function_2)
apply = ApplyFunction(list_of_fitness_functions, initialSolutionList)  # "Function.Apply"
assignFitnessFuncResults = Optimo.NSGA_II.AssignFitnessFuncResults(initialSolutionList, apply)
create = List.Create(code_block, assignFitnessFuncResults)
iteration_number = CodeBlock { 50; }
loop_completion_check = Custom[Loop Completion Check](Iteration_Number=iteration_number)  # A function that checcks if the loop is completed
nsga_ii_function = Custom[NSGA_II Function](lowerLimits=lower_limit_list, upperLimits=upper_limit_list, Fitness_Function_List=list_of_fitness_functions)  # The function that performs the generation for NSGA_II.
loopWhile = LoopWhile(create, loop_completion_check, nsga_ii_function)
code_block_2 = CodeBlock(a=loopWhile) { a[1]; }
code_block_3 = CodeBlock(Result=code_block_2) { Point.ByCoordinates(Result[1],Result[2],0); }
