# Dynamo graph Optimization Example-03-BBox.dyn (Dynamo 0.7.5.3566)

file_path = Filename("C:\Users\t_aslm\Desktop\gbXML\MOO SCH.csv")
code_block = CodeBlock { 1; }
# note: Read more about Optimo and how to use it on https://github.com/BPOpt/Optimo
population_size = CodeBlock { 50; }
number_of_objecctives = CodeBlock { 1; }
lower_limit = CodeBlock()
# ---------- lower_limit.designscript (6 lines) ----------
//Angle X
-180;
//Angle Y
-180;
//Angle Z
-180;
# ----------------------------------------
lower_limit_list = List.Create(lower_limit.out0, lower_limit.out1, lower_limit.out2)
upper_limit = CodeBlock()
# ---------- upper_limit.designscript (6 lines) ----------
//Angle X
180;
//Angle Y
180;
//Angle Z
180;
# ----------------------------------------
upper_limit_list = List.Create(upper_limit.out0, upper_limit.out1, upper_limit.out2)
initialSolutionList = Optimo.NSGA_II.InitialSolutionList(population_size, number_of_objecctives, lower_limit_list, upper_limit_list)
select_model_element = DSModelElementSelection()  # 1 picked in the model
geometry = Element.Geometry(select_model_element)
bbox_fitness_function = Custom[BBox Fitness Function](Geometry=geometry)  # The Fitness Function for Optimo's Bounding Box Example (Minimizing Bounding Box Volume)
list_of_fitness_functions = List.Create(bbox_fitness_function)
apply = ApplyFunction(list_of_fitness_functions, initialSolutionList)  # "Function.Apply"
assignFitnessFuncResults = Optimo.NSGA_II.AssignFitnessFuncResults(initialSolutionList, apply)
create = List.Create(code_block, assignFitnessFuncResults)
iteration_number = CodeBlock { 50; }
loop_completion_check = Custom[Loop Completion Check](Iteration_Number=iteration_number)  # A function that checcks if the loop is completed
nsga_ii_function = Custom[NSGA_II Function](lowerLimits=lower_limit_list, upperLimits=upper_limit_list, Fitness_Function_List=list_of_fitness_functions)  # The function that performs the generation for NSGA_II.
loopWhile = LoopWhile(create, loop_completion_check, nsga_ii_function)
# note: Saves the results to a CSV file.
code_block_2 = CodeBlock(a=loopWhile) { a[1]; }
writeToFile = CSV.WriteToFile(file_path, code_block_2)
byGeometry = BoundingBox.ByGeometry(geometry, lacing=Longest)
# note: Calculating the bounding box size of the original geometry for comparison to the optimized orientation.
maxPoint = BoundingBox.MaxPoint(byGeometry, lacing=Longest)
minPoint = BoundingBox.MinPoint(byGeometry, lacing=Longest)
byCorners = Cuboid.ByCorners(maxPoint, minPoint, lacing=Longest)
# note: Original Geometry Volume
volume = Solid.Volume(byCorners)
byGeometry_2 = BoundingBox.ByGeometry(geometry)
minPoint_2 = BoundingBox.MinPoint(byGeometry_2)
maxPoint_2 = BoundingBox.MaxPoint(byGeometry_2)
byStartPointEndPoint = Line.ByStartPointEndPoint(minPoint_2, maxPoint_2)
code_block_3 = CodeBlock { 0.5; }
# note: This part visulizes the optimized orientation of the model geometry and calculates the optimized bounding box volume.
pointAtParameter = Curve.PointAtParameter(byStartPointEndPoint, code_block_3)
XAxis = Vector.XAxis()
lastItem = List.LastItem(loopWhile)
firstItem = List.FirstItem()
map = List.Map(lastItem, firstItem)
code_block_4 = CodeBlock(a=map) { a[0]; a[1]; a[2]; }
rotate = Geometry.Rotate(geometry, pointAtParameter, XAxis, code_block_4.out0)
YAxis = Vector.YAxis()
rotate_2 = Geometry.Rotate(rotate, pointAtParameter, YAxis, code_block_4.out1)
ZAxis = Vector.ZAxis()
rotate_3 = Geometry.Rotate(rotate_2, pointAtParameter, ZAxis, code_block_4.out2)
code_block_5 = CodeBlock { Vector.ByCoordinates(20,0,0); }
translate = Geometry.Translate(rotate_3, code_block_5)
byGeometry_3 = BoundingBox.ByGeometry(translate, lacing=Longest)
maxPoint_3 = BoundingBox.MaxPoint(byGeometry_3, lacing=Longest)
minPoint_3 = BoundingBox.MinPoint(byGeometry_3, lacing=Longest)
byCorners_2 = Cuboid.ByCorners(maxPoint_3, minPoint_3, lacing=Longest)
# note: Optimized Geometry Volume
volume_2 = Solid.Volume(byCorners_2)
